# Grasshopper definition annual_daylight.gh (Grasshopper 1.0.7)

geo = Geometry(<brep referenced from the Rhino model>)
roomsolid = HBRoomFromSolid(geo=flatten(geo), conditioned=True)  # -> report, rooms; plug-in component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
geo_2 = Geometry(<brep referenced from the Rhino model>)
geo_3 = Geometry(<brep referenced from the Rhino model>)
geo_4 = Geometry([<brep referenced from the Rhino model> x4])
geo_5 = Geometry(<brep referenced from the Rhino model>)
geo_6 = Geometry(<brep referenced from the Rhino model>)
geo_7 = Geometry(<brep referenced from the Rhino model>)
geo_8 = Geometry([<brep referenced from the Rhino model> x4])
geo_9 = Geometry(<brep referenced from the Rhino model>)
geo_10 = Geometry(<brep referenced from the Rhino model>)
geo_11 = Geometry(<brep referenced from the Rhino model>)
geo_12 = Geometry([<brep referenced from the Rhino model> x5])
geo_13 = Geometry([<brep referenced from the Rhino model> x2])
face = HBFace(geo=geo_2, name="Floor", type="Floor")  # -> report, faces; plug-in component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
face_2 = HBFace(geo=geo_3, name="RoofCeiling", type="RoofCeiling")  # -> report, faces; plug-in component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
face_3 = HBFace(geo=geo_4, name="Wall", type="Wall")  # -> report, faces; plug-in component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
aperture = HBAperture(geo=geo_5)  # -> report, apertures; plug-in component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
geo_14 = Geometry([geo_2, geo_3, geo_4])
face_4 = HBFace(geo=geo_6, name="Floor", type="Floor")  # -> report, faces; plug-in component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
face_5 = HBFace(geo=geo_7, name="RoofCeiling", type="RoofCeiling")  # -> report, faces; plug-in component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
face_6 = HBFace(geo=geo_8, name="Wall", type="Wall")  # -> report, faces; plug-in component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
aperture_2 = HBAperture(geo=geo_9)  # -> report, apertures; plug-in component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
geo_15 = Geometry([geo_6, geo_7, geo_8, geo_9])
face_7 = HBFace(geo=geo_10, name="Floor", type="Floor")  # -> report, faces; plug-in component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
face_8 = HBFace(geo=geo_11, name="RoofCeiling", type="RoofCeiling")  # -> report, faces; plug-in component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
face_9 = HBFace(geo=geo_12, name="Wall", type="Wall")  # -> report, faces; plug-in component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
aperture_3 = HBAperture(geo=geo_13)  # -> report, apertures; plug-in component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
geo_16 = Geometry([geo_10, geo_11, geo_12, geo_13])
wires = BrepWireframe(Brep=geo_16, Density=-1)
wires_2 = BrepWireframe(Brep=geo_14, Density=-1)
wires_3 = BrepWireframe(Brep=geo_15, Density=-1)
panel = Panel("http://climate.onebuilding.org/WMO_Region_4_North_and_Central_America/USA_United_States_of_America/NY_New_York/USA_NY_New.York-Central.Park.Observatory-Belvedere.Castle.725053_TMY3.zip")
panel_2 = Panel("http://climate.onebuilding.org/WMO_Region_4_North_and_Central_America/USA_United_States_of_America/NY_New_York/USA_NY_New.York-Central.Park.Observatory-Belvedere.Castle.725053_TMY3.zip")
genpts = LBGeneratePointGrid(geometry=geo_2, grid_size=Slider(3000, range=500..4000))  # -> points, vectors, face_areas, graft(mesh); plug-in component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
genpts_2 = LBGeneratePointGrid(geometry=geo_6, grid_size=Slider(3000, range=500..4000))  # -> points, vectors, face_areas, graft(mesh); plug-in component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
panel_3 = Panel("http://climate.onebuilding.org/WMO_Region_4_North_and_Central_America/USA_United_States_of_America/NY_New_York/USA_NY_New.York-Central.Park.Observatory-Belvedere.Castle.725053_TMY3.zip")
genpts_3 = LBGeneratePointGrid(geometry=geo_10, grid_size=Slider(1250, range=500..4000))  # -> points, vectors, face_areas, graft(mesh); plug-in component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
downloadepw = LBDownloadWeather(weather_URL=panel)  # -> epw_file, stat_file, ddy_file; plug-in component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
epwmap = LBEPWmap(epw_map=Toggle(False))  # -> report; plug-in component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
downloadepw_2 = LBDownloadWeather(weather_URL=panel_2)  # -> epw_file, stat_file, ddy_file; plug-in component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
epwmap_2 = LBEPWmap(epw_map=Toggle(False))  # -> report; plug-in component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
pt = Point(genpts.points)
downloadepw_3 = LBDownloadWeather(weather_URL=panel_3)  # -> epw_file, stat_file, ddy_file; plug-in component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
pt_2 = Point(genpts_2.points)
epwmap_3 = LBEPWmap(epw_map=Toggle(False))  # -> report; plug-in component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
sensorgrid = HBSensorGrid(positions=genpts.points)  # -> grid; plug-in component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
pt_3 = Point(genpts_3.points)
sensorgrid_2 = HBSensorGrid(positions=genpts_2.points)  # -> grid; plug-in component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
model = HBModel(faces=flatten([face.faces, face_2.faces, face_3.faces]), apertures=flatten(aperture.apertures))  # -> report, model; plug-in component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
model_2 = HBModel(faces=flatten([face_4.faces, face_5.faces, face_6.faces]))  # -> report, model; plug-in component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
sensorgrid_3 = HBSensorGrid(positions=genpts_3.points)  # -> grid; plug-in component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
wea = HBWeaFromEPW(epw_file=downloadepw.epw_file)  # -> wea; plug-in component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
model_3 = HBModel(faces=flatten([face_7.faces, face_8.faces, face_9.faces]), apertures=flatten(aperture_3.apertures))  # -> report, model; plug-in component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
wea_2 = HBWeaFromEPW(epw_file=downloadepw_2.epw_file)  # -> wea; plug-in component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
wea_3 = HBWeaFromEPW(epw_file=downloadepw_3.epw_file)  # -> wea; plug-in component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
# 1. input name conventions (underscore)
# 2. start from solver (Annual Daylight in HB-R)
assigngridsviews = HBAssignGridsAndViews(model=model.model, grids=flatten(sensorgrid))  # -> model; plug-in component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
# 1. input name conventions (underscore)
# 2. start from solver (Annual Daylight in HB-R)
assigngridsviews_2 = HBAssignGridsAndViews(model=model_2.model, grids=flatten(sensorgrid_2))  # -> model; plug-in component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
# 1. input name conventions (underscore)
# 2. start from solver (Annual Daylight in HB-R)
assigngridsviews_3 = HBAssignGridsAndViews(model=model_3.model, grids=flatten(sensorgrid_3))  # -> model; plug-in component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
legendpar = LBLegendParameters(min="0", max="100")  # -> leg_par; plug-in component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
annualdaylight = HBAnnualDaylight(model=assigngridsviews, wea=wea, run=Toggle(True))  # -> report, results, DA, cDA, UDI, UDI_low, UDI_up; plug-in component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
annualdaylight_2 = HBAnnualDaylight(model=assigngridsviews_2, wea=wea_2, run=Toggle(True))  # -> report, results, DA, cDA, UDI, UDI_low, UDI_up; plug-in component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
legendpar_2 = LBLegendParameters(min="0", max="100")  # -> leg_par; plug-in component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
annualdaylight_3 = HBAnnualDaylight(model=assigngridsviews_3, wea=wea_3, run=Toggle(False))  # -> report, results, DA, cDA, UDI, UDI_low, UDI_up; plug-in component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
daylightfactor = HBDaylightFactor(model=assigngridsviews_3, run=Toggle(True))  # -> report, results; plug-in component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
heatmap = LBSpatialHeatmap(values=annualdaylight.DA, mesh=genpts.mesh, legend_par=legendpar)  # -> mesh, legend, title, colors, legend_par; plug-in component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
avr = Average(Input=annualdaylight.UDI)
avr_2 = Average(Input=annualdaylight.DA)
panel_4 = Panel(annualdaylight.DA)
heatmap_2 = LBSpatialHeatmap(values=annualdaylight_2.DA, mesh=genpts_2.mesh, legend_par=legendpar)  # -> mesh, legend, title, colors, legend_par; plug-in component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
panel_5 = Panel(annualdaylight_2.DA)
avr_3 = Average(Input=annualdaylight_2.UDI)
avr_4 = Average(Input=annualdaylight_2.DA)
heatmap_3 = LBSpatialHeatmap(values=daylightfactor.results, mesh=genpts_3.mesh)  # -> mesh, legend, title, colors, legend_par; plug-in component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
heatmap_4 = LBSpatialHeatmap(values=annualdaylight_3.DA, mesh=genpts_3.mesh, legend_par=legendpar)  # -> mesh, legend, title, colors, legend_par; plug-in component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
avr_5 = Average(Input=annualdaylight_3.UDI)
avr_6 = Average(Input=annualdaylight_3.DA)
panel_6 = Panel(annualdaylight_3.DA)
panel_7 = Panel(avr)
panel_8 = Panel(avr_2)
panel_9 = Panel(avr_3)
panel_10 = Panel(avr_4)
panel_11 = Panel(avr_5)
panel_12 = Panel(avr_6)
importepw = LBImportEPW(epw_file=downloadepw.epw_file)  # -> location, dry_bulb_temperature, dew_point_temperature, relative_humidity, wind_speed, wind_direction, direct_normal_rad, diffuse_horizontal_rad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; plug-in component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
sunpath = LBSunPath(location=importepw.location, hoys=Slider(424, range=200..1000), scale=1)  # -> report, vectors, altitudes, azimuths, hoys, sun_pts, analemma, daily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; plug-in component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
